# Grasshopper definition 20140628 Settlement Decision Model_msr.gh (Grasshopper 0.9.76)
# plug-ins: Python Interpreter

# ---- group: County Border
black = ColourSwatch(SwatchColor=RGB(0, 0, 0))
county_border = Curve(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)
preview = CustomPreview(Geometry=county_border, Shader=black)

# ----
series = Series(Start=0, Step=1, Count=Slider(3, range=2..34))  # -> simplify(Series)

# ---- group: Settlement Points + Population
# Settlement Point List: Panama
# Cherry Creek
# Ripley
# Brocton
# Westfield
# Sharman
# Sincalirville
# Fredonia
# Cassadaga
# Chautauqua Institution
# Frewsburg
# Busti
# Kennedy
# Sunset Bay
# Forestville
# Dunkirk
# Silver Creek
# Falconer
# Celoron
# Bemus Point
# Mayville
# Lakewood
# Jamestown West
# Jamestown
input_settlement_points_to_study = Panel("""15
23""")
settlement_populations = Panel("""4572
5211
2452
5579
4896
4813
4674
11702
4527
3618
5999
4122
4558
637
4790
12836
2035
2619
1686
4457
917
3229
1834
31146""")

# ----
int = Integer(input_settlement_points_to_study)
pshift = ShiftPaths(Data=int, Offset=-1)

# ---- group: Developed
change_in_density = Slider(1, range=0.1..2)
change_in_durable_goods = Slider(1, range=0.1..2)
change_in_water_consumption = Slider(1, range=0.1..2)
change_in_waste_production = Slider(1, range=0.1..2)
amount_of_waste_recycled = Slider(0.34, range=0..1)

# ---- group: Transport
change_in_average_miles_driven = Slider(1, range=0.1..2)
change_in_vehicle_efficiency = Slider(1, range=0.1..2)
gasoline_as_biofuels = Slider(0.1, range=0..1)

# ---- group: Food
change_in_food_demand = Slider(1, range=0.1..2)
diet_grains = Slider(0.46, range=0..1)
diet_vegetables = Slider(0.12, range=0..1)
diet_fruit = Slider(0.09, range=0..1)
diet_dairy = Slider(0.05, range=0..1)
diet_meat = Slider(0.23, range=0..1)
diet_fish = Slider(0.08, range=0..1)
change_in_food_production_efficiency = Slider(1, range=0.1..2)

# ----
settlement_points_selected = Panel(int)
panel = Panel(pshift)
item = ListItem(List=settlement_populations, Index=settlement_points_selected, Wrap=True)

# ---- group: Developed Area
acres_per_person = Panel("0.369518675")
p_x_a_p = Multiplication(A=item, B=acres_per_person)
division = Division(A="1", B=change_in_density)
developed_area = Multiplication(A=p_x_a_p, B=division)

# ---- group: Water Consumption
l_per_person = Panel("213417")
p_x_l_p = Multiplication(A=item, B=l_per_person)
water_consumption_l = Multiplication(A=p_x_l_p, B=change_in_water_consumption)
sej_l = Panel("724511111")
l_x_sej_l = Multiplication(A=water_consumption_l, B=sej_l)

# ---- group: Construction (Developed Area)
developed_area_2 = Panel(developed_area)
acre_to_m2 = Panel("4046.86")
developed_area_m2 = Multiplication(A=developed_area_2, B=acre_to_m2)
sej_m2 = Panel("831880772016")
l_x_sej_m2 = Multiplication(A=developed_area_m2, B=sej_m2)

# ---- group: Transport - Gasoline
miles_driven_per_person = Panel("6884")
change_in_miles_driven = Multiplication(A=change_in_average_miles_driven, B=miles_driven_per_person)
p_x_miles = Multiplication(A=item, B=change_in_miles_driven)
mpg = Panel("23.6")
change_in_mpg = Multiplication(A=change_in_vehicle_efficiency, B=mpg)
total_gallons = Division(A=p_x_miles, B=change_in_mpg)
gasoline = Subtraction(A="1", B=gasoline_as_biofuels)
gallons_of_gasoline = Multiplication(A=total_gallons, B=gasoline)
gallons_to_grams_gasoline = Panel("2834")
grams_of_gasoline = Multiplication(A=gallons_of_gasoline, B=gallons_to_grams_gasoline)
sej_g = Panel("2784643")
g_x_sej_g_gasoline = Multiplication(A=grams_of_gasoline, B=sej_g)

# ---- group: Durable Goods
per_person = Panel("1342.62")
p_x_p = Multiplication(A=item, B=per_person)
total_durable_goods = Multiplication(A=p_x_p, B=change_in_durable_goods)
sej = Panel("2500000000000")
x_sej = Multiplication(A=total_durable_goods, B=sej)

# ---- group: Food Demand
food_j_per_person = Panel("2883040000")
p_x_j_p = Multiplication(A=item, B=food_j_per_person)
total_food_demand = Multiplication(A=p_x_j_p, B=change_in_food_demand)

# ----
landfill = Subtraction(A="1", B=amount_of_waste_recycled)

# ---- group: Dairy
dairy_demand = Multiplication(A=total_food_demand, B=diet_dairy)
dairy_j_acre = Panel("834154741")
efficiency = Multiplication(A=change_in_food_production_efficiency, B=dairy_j_acre)
area = Division(A=dairy_demand, B=efficiency)
sej_j = Panel("600000")
sej_acres = Panel("1965772451393830")
j_x_sej_j = Multiplication(A=dairy_demand, B=sej_j)
renewable_inputs = Multiplication(A=area, B=sej_acres)
purchaed_renewables = Addition(A=renewable_inputs, B=j_x_sej_j)
purchased_renewables_renewables = Division(A=purchaed_renewables, B=renewable_inputs)
dairy_sej_ratio = Panel(purchased_renewables_renewables)
dairy_area_x_dairy_sej_ratio = Multiplication(A=area, B=dairy_sej_ratio)
total_dairy_area_acres = Panel(dairy_area_x_dairy_sej_ratio)

# ---- group: Settlement Point
settlement_borders = Curve(flatten([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]))
pcen = PolygonCenter(Polyline=settlement_borders)  # -> CenterV, CenterE, CenterA
pt = Point(pcen.CenterV)
item_2 = ListItem(List=pt, Index=settlement_points_selected, Wrap=True)
settlement_point = Point(item_2)

# ---- group: Cell Area Calculator
int_2 = Integer(251001)
total_area_acres = Panel("1581470")
number_of_cells = Panel(int_2)
division_2 = Division(A=total_area_acres, B=number_of_cells)
cell_area_acres = Panel(division_2)

# ----
takers = Point(settlement_point)
population = Text(simplify(Tree({0}: ["1401", "1401", "1401", "1401", "1401", "1401"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], {1}: ["1401", "1401", "1401", "1401", "1401", "1401"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], {2}: ["1401", "1401", "1401", "1401", "1401", "1401"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], {3}: ["1401", "1401", "1401", "1401", "1401", "1401"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], {4}: ["1401", "1401", "1401", "1401", "1401", "1401"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], {5}: ["1401", "1401", "1401", "1401", "1401", "1401"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])))
point_list = Point(Tree({0}: [Point(73, 43.2, 0), Point(49.4, 36.8, 0), Point(53, 10.6, 0), Point(61, 12.6, 0), Point(61, 12.4, 0), Point(73, 44.8, 0)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], {1}: [Point(63.2, 16.6, 0), Point(72, 25, 0), Point(72, 64.8, 0), Point(79.2, 47, 0), Point(79.2, 46.8, 0), Point(84, 37.8, 0)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], {2}: [Point(48.6, 24.2, 0), Point(72, 23.4, 0), Point(83.8, 30.2, 0), Point(83.8, 75.8, 0), Point(72, 24.4, 0), Point(83.8, 52.6, 0)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], {3}: [Point(14.6, 24, 0), Point(14.6, 24.2, 0), Point(78.6, 15.6, 0), Point(23.4, 19, 0), Point(25.6, 21.4, 0), Point(78.6, 13.8, 0)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], {4}: [Point(34.4, 82.4, 0), Point(34.4, 82.8, 0), Point(34.4, 55.6, 0), Point(34.4, 82.2, 0), Point(34.4, 82.6, 0), Point(34.4, 79, 0)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], {5}: [Point(79.6, 14.8, 0), Point(62.6, 15.6, 0), Point(68.4, 17.8, 0), Point(56.6, 61.6, 0), Point(77.4, 75.4, 0), Point(41.6, 12.8, 0)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]))
lng = ListLength(List=takers)
landuse = Text(Tree({0}: ["Forest", "Forest", "Forest", "Forest", "Forest", "Forest"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], {1}: ["Natural", "Natural", "Natural", "Natural", "Natural", "Natural"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], {2}: ["Agriculture", "Agriculture", "Agriculture", "Agriculture", "Agriculture", "Agriculture"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], {3}: ["Wetlands", "Wetlands", "Wetlands", "Wetlands", "Wetlands", "Wetlands"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], {4}: ["Water", "Water", "Water", "Water", "Water", "Water"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], {5}: ["Developed", "Developed", "Developed", "Developed", "Developed", "Developed"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]))
rec = Rectangle(Tree({0}: [{Plane=PlaneXY(73, 43.2, 0), Size=Domain2(u=-0.1..0.1, v=-0.1..0.1)}, {Plane=PlaneXY(49.4, 36.8, 0), Size=Domain2(u=-0.1..0.1, v=-0.1..0.1)}, {Plane=PlaneXY(53, 10.6, 0), Size=Domain2(u=-0.1..0.1, v=-0.1..0.1)}, {Plane=PlaneXY(61, 12.6, 0), Size=Domain2(u=-0.1..0.1, v=-0.1..0.1)}, {Plane=PlaneXY(61, 12.4, 0), Size=Domain2(u=-0.1..0.1, v=-0.1..0.1)}, {Plane=PlaneXY(73, 44.8, 0), Size=Domain2(u=-0.1..0.1, v=-0.1..0.1)}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], {1}: [{Plane=PlaneXY(63.2, 16.6, 0), Size=Domain2(u=-0.1..0.1, v=-0.1..0.1)}, {Plane=PlaneXY(72, 25, 0), Size=Domain2(u=-0.1..0.1, v=-0.1..0.1)}, {Plane=PlaneXY(72, 64.8, 0), Size=Domain2(u=-0.1..0.1, v=-0.1..0.1)}, {Plane=PlaneXY(79.2, 47, 0), Size=Domain2(u=-0.1..0.1, v=-0.1..0.1)}, {Plane=PlaneXY(79.2, 46.8, 0), Size=Domain2(u=-0.1..0.1, v=-0.1..0.1)}, {Plane=PlaneXY(84, 37.8, 0), Size=Domain2(u=-0.1..0.1, v=-0.1..0.1)}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], {2}: [{Plane=PlaneXY(48.6, 24.2, 0), Size=Domain2(u=-0.1..0.1, v=-0.1..0.1)}, {Plane=PlaneXY(72, 23.4, 0), Size=Domain2(u=-0.1..0.1, v=-0.1..0.1)}, {Plane=PlaneXY(83.8, 30.2, 0), Size=Domain2(u=-0.1..0.1, v=-0.1..0.1)}, {Plane=PlaneXY(83.8, 75.8, 0), Size=Domain2(u=-0.1..0.1, v=-0.1..0.1)}, {Plane=PlaneXY(72, 24.4, 0), Size=Domain2(u=-0.1..0.1, v=-0.1..0.1)}, {Plane=PlaneXY(83.8, 52.6, 0), Size=Domain2(u=-0.1..0.1, v=-0.1..0.1)}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], {3}: [{Plane=PlaneXY(14.6, 24, 0), Size=Domain2(u=-0.1..0.1, v=-0.1..0.1)}, {Plane=PlaneXY(14.6, 24.2, 0), Size=Domain2(u=-0.1..0.1, v=-0.1..0.1)}, {Plane=PlaneXY(78.6, 15.6, 0), Size=Domain2(u=-0.1..0.1, v=-0.1..0.1)}, {Plane=PlaneXY(23.4, 19, 0), Size=Domain2(u=-0.1..0.1, v=-0.1..0.1)}, {Plane=PlaneXY(25.6, 21.4, 0), Size=Domain2(u=-0.1..0.1, v=-0.1..0.1)}, {Plane=PlaneXY(78.6, 13.8, 0), Size=Domain2(u=-0.1..0.1, v=-0.1..0.1)}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], {4}: [{Plane=PlaneXY(34.4, 82.4, 0), Size=Domain2(u=-0.1..0.1, v=-0.1..0.1)}, {Plane=PlaneXY(34.4, 82.8, 0), Size=Domain2(u=-0.1..0.1, v=-0.1..0.1)}, {Plane=PlaneXY(34.4, 55.6, 0), Size=Domain2(u=-0.1..0.1, v=-0.1..0.1)}, {Plane=PlaneXY(34.4, 82.2, 0), Size=Domain2(u=-0.1..0.1, v=-0.1..0.1)}, {Plane=PlaneXY(34.4, 82.6, 0), Size=Domain2(u=-0.1..0.1, v=-0.1..0.1)}, {Plane=PlaneXY(34.4, 79, 0), Size=Domain2(u=-0.1..0.1, v=-0.1..0.1)}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], {5}: [{Plane=PlaneXY(79.6, 14.8, 0), Size=Domain2(u=-0.1..0.1, v=-0.1..0.1)}, {Plane=PlaneXY(62.6, 15.6, 0), Size=Domain2(u=-0.1..0.1, v=-0.1..0.1)}, {Plane=PlaneXY(68.4, 17.8, 0), Size=Domain2(u=-0.1..0.1, v=-0.1..0.1)}, {Plane=PlaneXY(56.6, 61.6, 0), Size=Domain2(u=-0.1..0.1, v=-0.1..0.1)}, {Plane=PlaneXY(77.4, 75.4, 0), Size=Domain2(u=-0.1..0.1, v=-0.1..0.1)}, {Plane=PlaneXY(41.6, 12.8, 0), Size=Domain2(u=-0.1..0.1, v=-0.1..0.1)}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]))
col = Colour(Tree({1}: [RGB(62, 202, 102)], {2}: [RGB(155, 217, 86)], {3}: [RGB(245, 234, 11)], {4}: [RGB(19, 116, 132)], {5}: [RGB(0, 163, 219)], {6}: [RGB(230, 56, 92)]))
grey_5 = ColourSwatch(SwatchColor=RGB(51, 51, 51))
grey_5_2 = ColourSwatch(SwatchColor=RGB(51, 51, 51))

# ---- group: Energy
change_in_energy_demand = Slider(1, range=0.1..2)
energy_mix_pvs = Slider(0.1, range=0..1)
energy_mix_biomass = Slider(0.1, range=0..1)
energy_mix_wind = Slider(0.1, range=0..1)
change_in_energy_production_efficiency = Slider(1, range=0.1..2)

# ---- group: Other Fuels
sum_renewables = Addition(A=energy_mix_pvs, B=energy_mix_biomass, C=energy_mix_wind)
subtraction = Subtraction(A="1", B=sum_renewables)

# ---- group: Energy (continued)
energy_mix_other_fossil_fuels_etc = Panel(subtraction)

# ---- group: Energy Demand
energy_j_person = Panel("131133748584.156")
p_x_a_p_2 = Multiplication(A=item, B=energy_j_person)
total_energy_demand = Multiplication(A=p_x_a_p_2, B=change_in_energy_demand)

# ---- group: Energy - BioMass
total_pv_j = Multiplication(A=energy_mix_pvs, B=total_energy_demand)
pv_j_acre = Panel("2858627594234")
efficiency_2 = Multiplication(A=pv_j_acre, B=change_in_energy_production_efficiency)
area_2 = Division(A=total_pv_j, B=efficiency_2)
sej_j_2 = Panel("145000")
sej_acres_2 = Panel("1965772451393830")
j_x_sej_j_2 = Multiplication(A=total_pv_j, B=sej_j_2)
renewable_inputs_2 = Multiplication(A=area_2, B=sej_acres_2)
purchaed_renewables_2 = Addition(A=renewable_inputs_2, B=j_x_sej_j_2)
purchased_renewables_renewables_2 = Division(A=purchaed_renewables_2, B=renewable_inputs_2)
pv_sej_ratio = Panel(purchased_renewables_renewables_2)
pv_area_x_pv_sej_ratio = Multiplication(A=area_2, B=pv_sej_ratio)
total_pv_area_acres = Panel(pv_area_x_pv_sej_ratio)

total_biomass_j = Multiplication(A=energy_mix_biomass, B=total_energy_demand)
biomass_j_acre = Panel("683194255")
efficiency_3 = Multiplication(A=biomass_j_acre, B=change_in_energy_production_efficiency)
sej_j_3 = Panel("67222")
sej_acres_3 = Panel("1965772451393830")
area_3 = Division(A=total_biomass_j, B=efficiency_3)
j_x_sej_j_3 = Multiplication(A=total_biomass_j, B=sej_j_3)
renewable_inputs_3 = Multiplication(A=area_3, B=sej_acres_3)
purchaed_renewables_3 = Addition(A=renewable_inputs_3, B=j_x_sej_j_3)
purchased_renewables_renewables_3 = Division(A=purchaed_renewables_3, B=renewable_inputs_3)
biomass_sej_ratio = Panel(purchased_renewables_renewables_3)
biomass_area_x_biomass_sej_ratio = Multiplication(A=area_3, B=biomass_sej_ratio)
total_biomass_area_acres = Panel(biomass_area_x_biomass_sej_ratio)

# ---- group: Energy - Other Fuels
total_other_fuels_j = Multiplication(A=energy_mix_other_fossil_fuels_etc, B=total_energy_demand)
other_sej_j = Panel("190283")
j_x_sej_j_4 = Multiplication(A=total_other_fuels_j, B=other_sej_j)

# ---- group: Energy - Wind
total_wind_j = Multiplication(A=energy_mix_wind, B=total_energy_demand)
wind_sej_j = Panel("110000")
j_x_sej_j_5 = Multiplication(A=total_wind_j, B=wind_sej_j)

# ----
panel_2 = Panel(area_2)

# ---- group: Waste & Recycling
lbs_per_person = Panel("4.38")
p_x_lbs_p = Multiplication(A=item, B=lbs_per_person)
waste_production_lbs = Multiplication(A=p_x_lbs_p, B=change_in_waste_production)
recylcing_lbs = Multiplication(A=amount_of_waste_recycled, B=waste_production_lbs)
sej_g_2 = Panel("297000000000")
sej_g_3 = Panel("34277417218")

# ----
landfill_waste_lbs = Multiplication(A=landfill, B=waste_production_lbs)
convert_to_g = Multiplication(A="453.592", B=recylcing_lbs)

# ---- group: Waste & Recycling (continued)
convert_to_g_2 = Multiplication(A="453.592", B=landfill_waste_lbs)
lbs_x_sej_lb_landfill = Multiplication(A=convert_to_g_2, B=sej_g_2)
lbs_x_sej_lb_recycle = Multiplication(A=convert_to_g, B=sej_g_3)

# ---- group: Development SeJ Ratio
sej_acres_4 = Panel("523329183208201")
renewable_inputs_4 = Multiplication(A=sej_acres_4, B=developed_area)
purchased_inputs = Addition(
    A=x_sej,
    B=l_x_sej_l,
    C=lbs_x_sej_lb_landfill,
    D=lbs_x_sej_lb_recycle,
    E=l_x_sej_m2,
    F=g_x_sej_g_gasoline,
    G=j_x_sej_j_4,
    H=j_x_sej_j_5)
purchaed_renewables_4 = Addition(A=renewable_inputs_4, B=purchased_inputs)
purchased_renewables_renewables_4 = Division(A=purchaed_renewables_4, B=renewable_inputs_4)
development_sej_ratio = Panel(purchased_renewables_renewables_4)

# ----
developed_area_x_development_sej_ratio = Multiplication(A=developed_area, B=development_sej_ratio)
total_developed_area_acres = Panel(developed_area_x_development_sej_ratio)

# ---- group: BioFuels
change_in_miles_driven_2 = Multiplication(A=change_in_average_miles_driven, B=miles_driven_per_person)
p_x_miles_2 = Multiplication(A=item, B=change_in_miles_driven_2)
change_in_mpg_2 = Multiplication(A=change_in_vehicle_efficiency, B=mpg)
total_gallons_2 = Division(A=p_x_miles_2, B=change_in_mpg_2)
gallons_to_j = Panel("88565400")
gallons_of_biofuels = Multiplication(A=gasoline_as_biofuels, B=total_gallons_2)
demand_convert_to_j = Multiplication(A=gallons_of_biofuels, B=gallons_to_j)
biofuel_j_acre = Panel("27410517697")
efficiency_4 = Multiplication(A=change_in_food_production_efficiency, B=biofuel_j_acre)
area_4 = Division(A=demand_convert_to_j, B=efficiency_4)
sej_j_4 = Panel("650000")
sej_acres_5 = Panel("1965772451393830")
renewable_inputs_5 = Multiplication(A=area_4, B=sej_acres_5)

# ----
j_x_sej_j_6 = Multiplication(A=demand_convert_to_j, B=sej_j_4)

# ---- group: BioFuels (continued)
purchaed_renewables_5 = Addition(A=renewable_inputs_5, B=j_x_sej_j_6)
purchased_renewables_renewables_5 = Division(A=purchaed_renewables_5, B=renewable_inputs_5)
biofuels_sej_ratio = Panel(purchased_renewables_renewables_5)
biofuels_area_x_biofuels_sej_ratio = Multiplication(A=area_4, B=biofuels_sej_ratio)
total_biofuels_area_acres = Panel(biofuels_area_x_biofuels_sej_ratio)

# ---- group: Grains
grain_demand = Multiplication(A=total_food_demand, B=diet_grains)
grains_j_acre = Panel("9106580578")
efficiency_5 = Multiplication(A=change_in_food_production_efficiency, B=grains_j_acre)
area_5 = Division(A=grain_demand, B=efficiency_5)
sej_acres_6 = Panel("1965772451393830")
sej_j_5 = Panel("600000")
renewable_inputs_6 = Multiplication(A=area_5, B=sej_acres_6)

# ----
j_x_sej_j_7 = Multiplication(A=grain_demand, B=sej_j_5)

# ---- group: Grains (continued)
purchaed_renewables_6 = Addition(A=renewable_inputs_6, B=j_x_sej_j_7)
purchased_renewables_renewables_6 = Division(A=purchaed_renewables_6, B=renewable_inputs_6)
grains_sej_ratio = Panel(purchased_renewables_renewables_6)
grains_area_x_grains_sej_ratio = Multiplication(A=area_5, B=grains_sej_ratio)
total_grains_area_acres = Panel(grains_area_x_grains_sej_ratio)

# ---- group: Vegetables
vegetable_demand = Multiplication(A=total_food_demand, B=diet_vegetables)
vegetables_j_acre = Panel("657850587")
efficiency_6 = Multiplication(A=change_in_food_production_efficiency, B=vegetables_j_acre)
area_6 = Division(A=vegetable_demand, B=efficiency_6)
sej_acres_7 = Panel("1965772451393830")
sej_j_6 = Panel("600000")
renewable_inputs_7 = Multiplication(A=area_6, B=sej_acres_7)

# ----
j_x_sej_j_8 = Multiplication(A=vegetable_demand, B=sej_j_6)

# ---- group: Vegetables (continued)
purchaed_renewables_7 = Addition(A=renewable_inputs_7, B=j_x_sej_j_8)
purchased_renewables_renewables_7 = Division(A=purchaed_renewables_7, B=renewable_inputs_7)
vegetables_sej_ratio = Panel(purchased_renewables_renewables_7)
vegetables_area_x_vegetables_sej_ratio = Multiplication(A=area_6, B=vegetables_sej_ratio)
total_vegetables_area_acres = Panel(vegetables_area_x_vegetables_sej_ratio)

# ---- group: Fruit
fruit_demand = Multiplication(A=total_food_demand, B=diet_fruit)
fruit_j_acre = Panel("18271548471")
efficiency_7 = Multiplication(A=change_in_food_production_efficiency, B=fruit_j_acre)
area_7 = Division(A=fruit_demand, B=efficiency_7)
sej_j_7 = Panel("600000")
sej_acres_8 = Panel("1965772451393830")
renewable_inputs_8 = Multiplication(A=area_7, B=sej_acres_8)

# ----
j_x_sej_j_9 = Multiplication(A=fruit_demand, B=sej_j_7)

# ---- group: Fruit (continued)
purchaed_renewables_8 = Addition(A=renewable_inputs_8, B=j_x_sej_j_9)
purchased_renewables_renewables_8 = Division(A=purchaed_renewables_8, B=renewable_inputs_8)
fruit_sej_ratio = Panel(purchased_renewables_renewables_8)
fruit_area_x_fruit_sej_ratio = Multiplication(A=area_7, B=fruit_sej_ratio)
total_fruit_area_acres = Panel(fruit_area_x_fruit_sej_ratio)

# ---- group: Meat
meat_demand = Multiplication(A=total_food_demand, B=diet_meat)
meat_j_acre = Panel("393161592")
efficiency_8 = Multiplication(A=change_in_food_production_efficiency, B=meat_j_acre)
area_8 = Division(A=meat_demand, B=efficiency_8)
sej_j_8 = Panel("3270000")
sej_acres_9 = Panel("1965772451393830")
renewable_inputs_9 = Multiplication(A=area_8, B=sej_acres_9)

# ----
j_x_sej_j_10 = Multiplication(A=meat_demand, B=sej_j_8)

# ---- group: Meat (continued)
purchaed_renewables_9 = Addition(A=renewable_inputs_9, B=j_x_sej_j_10)
purchased_renewables_renewables_9 = Division(A=purchaed_renewables_9, B=renewable_inputs_9)
meat_sej_ratio = Panel(purchased_renewables_renewables_9)
meat_area_x_meat_sej_ratio = Multiplication(A=area_8, B=meat_sej_ratio)
total_meat_area_acres = Panel(meat_area_x_meat_sej_ratio)

# ---- group: Fish
fish_demand = Multiplication(A=total_food_demand, B=diet_fish)
fish_j_acre = Panel("393161592")
efficiency_9 = Multiplication(A=change_in_food_production_efficiency, B=fish_j_acre)
area_9 = Division(A=fish_demand, B=efficiency_9)
sej_j_9 = Panel("650000")
sej_acres_10 = Panel("6879577662342830")
renewable_inputs_10 = Multiplication(A=area_9, B=sej_acres_10)

# ----
j_x_sej_j_11 = Multiplication(A=fish_demand, B=sej_j_9)

# ---- group: Fish (continued)
purchaed_renewables_10 = Addition(A=renewable_inputs_10, B=j_x_sej_j_11)
purchased_renewables_renewables_10 = Division(A=purchaed_renewables_10, B=renewable_inputs_10)
fish_sej_ratio = Panel(purchased_renewables_renewables_10)
fish_area_x_fish_sej_ratio = Multiplication(A=area_9, B=fish_sej_ratio)
total_fish_area_acres = Panel(fish_area_x_fish_sej_ratio)

# ---- group: Joules Area
agriculture_area_total = Addition(A=area_5, B=area_6, C=area_7, D=area, E=area_8, F=area_4)
lng_2 = ListLength(List=settlement_points_selected)
no_area_count = Number(0)
repeat = RepeatData(Data=no_area_count, Length=lng_2)
forest_area_total = Addition(A=area_2, B=area_3)
natural_wetlands_area_required_acres = Panel(repeat)
developed_area_required_acres = Panel(developed_area)
agriculture_area_required_acres = Panel(agriculture_area_total)
forest_area_required_acres = Panel(forest_area_total)
water_area_required_acres = Panel(area_9)

# ---- group: Solar EmJoules Area
agriculture_area_total_2 = Addition(
    A=total_grains_area_acres,
    B=total_vegetables_area_acres,
    C=total_fruit_area_acres,
    D=total_dairy_area_acres,
    E=total_meat_area_acres,
    F=total_biofuels_area_acres)
lng_3 = ListLength(List=settlement_points_selected)
no_area_count_2 = Number(0)
repeat_2 = RepeatData(Data=no_area_count_2, Length=lng_3)
forest_area_total_2 = Addition(A=total_pv_area_acres, B=total_biomass_area_acres)
natural_wetlands_area_required_acres_2 = Panel(repeat_2)
developed_area_required_acres_2 = Panel(total_developed_area_acres)
agriculture_area_required_acres_2 = Panel(agriculture_area_total_2)
forest_area_required_acres_2 = Panel(forest_area_total_2)
water_area_required_acres_2 = Panel(total_fish_area_acres)

# ----
int_3 = Integer(simplify(natural_wetlands_area_required_acres_2))
forest = Division(A=forest_area_required_acres_2, B=cell_area_acres)
agriculture = Division(A=agriculture_area_required_acres_2, B=cell_area_acres)
water = Division(A=water_area_required_acres_2, B=cell_area_acres)
developed = Division(A=developed_area_required_acres_2, B=cell_area_acres)
pshift_2 = ShiftPaths(Data=int_3, Offset=-1)
int_4 = Integer(forest)
int_5 = Integer(agriculture)
int_6 = Integer(water)
int_7 = Integer(developed)
panel_3 = Panel(int_6)
panel_4 = Panel(int_4)
panel_5 = Panel(int_5)
panel_6 = Panel(int_7)
panel_7 = Panel(pshift_2)
python = PythonScript(
    pxPts=point_list,
    takers=takers,
    forest=panel_4,
    natural=natural_wetlands_area_required_acres_2,
    agriculture=panel_5,
    wetlands=natural_wetlands_area_required_acres_2,
    water=panel_3,
    developed=panel_6)  # -> i, i_I, i_II; inputs pxPts: tree of Point3d, takers: list of Point3d, forest: list of Int32, natural: list of Int32, agriculture: list of Int32, wetlands: list of Int32, water: list of Int32, developed: list of Int32
# ---------- python: Python ----------
import Rhino as rc
import scriptcontext as sc
import Grasshopper.Kernel as gh
from System import Object
from Grasshopper import DataTree
from Grasshopper.Kernel.Data import GH_Path

class sourcePx(object):
    def __init__(self, id, location):
        self.id = id
        self.location = location
        self.distanceTo = {}
        self.isTaken = False
        self.takerRank = {}
        
    def rankTakers(self, takersCollection):
        sortedTakers = sorted(takersCollection,  key=lambda tk: tk.distanceTo[self.id])
        
        for count, tk in enumerate(sortedTakers):
            self.takerRank[tk.id] = count 
        
class taker(object):
    
    def __init__(self, id, location, needs):
        self.id = id
        self.location = location
        self.distanceTo = {}
        self.sortedPx = {}
        self.need = []
        for n in needs: self.need.append(n[id])
        self.takenCount = {}
        self.isSatisfied = {}
        for landuse in range(len(self.need)):
            self.takenCount[landuse] = 0
            self.isSatisfied[landuse] = False
        
        self.taken = {
                       "roundI" : [],
                       "roundII" : [],
                       "roundIII" : []
                      }
        # create empty lists for each need for each round
        for round in self.taken.keys():
            for landuse in range(len(self.need)):
                self.taken[round].append([])
                
    def getDistanceTo(self, px):
        distance = px.location.DistanceTo(self.location)
        px.distanceTo[self.id] = distance
        self.distanceTo[px.id] = distance
    
    def sortPxBasedOnDist(self, landuse, pxCollection):
        # find distance
        for px in pxCollection:
            self.getDistanceTo(px)
        
        # sort px based on distance
        self.sortedPx[landuse] = sorted(pxCollection,  key=lambda px: px.distanceTo[self.id])
        

def main(pxPts, takers, need):
    """
    pixels as a list of points
    takers as list of points
    need as an integer
    """
    
    takersCollection = []
    # create an object for every taker
    for id, tPt in enumerate(takers):
        tk = taker(id, tPt, need) 
        takersCollection.append(tk)
    
    pxCollection = {}
    
    for landuse in range(len(need)):
        pixels = pxPts.Branch(landuse)
        pxCollectForEachLandUse = []
        # create an object for each px and find distance to takers
        for id, pt in enumerate(pixels):
            px = sourcePx(id, pt)
            pxCollectForEachLandUse.append(px)
            
        pxCollection[landuse] = pxCollectForEachLandUse
    
    # rank all the takers 
    for landuse in pxCollection.keys():
        # each taker rank the pixels based on distance
        for tk in takersCollection:
            tk.sortPxBasedOnDist(landuse, pxCollection[landuse])
    
        # let each pixel also rank the takers based on distance
        for px in pxCollection[landuse]:
            px.rankTakers(takersCollection)
    
    # now that everything is ranked let's see who can take whome
    satisfied = []
    for landuse in range(len(need)): satisfied.append(0) 
    
    # round I - each taker will try to take as much as it needs from pixels
    # with similar land use
    for landuse in range(len(need)):
        for rank in range(len(takers)):
            if satisfied[landuse] >= len(takers):
                break
            else:
                for tk in takersCollection:
                    for px in tk.sortedPx[landuse]:
                        if tk.takenCount[landuse] >= tk.need[landuse]:
                            tk.isSatisfied[landuse] = True
                            satisfied[landuse] += 1 # one of the takers is satisfied
                            break
                        else:
                            # check if taker is eligible to take this px
                            if not px.isTaken and px.takerRank[tk.id] == rank:
                                # take it
                                tk.taken["roundI"][landuse].append(px)
                                tk.takenCount[landuse] += 1
                                px.isTaken = True
    
    # assert False
    # round II and III
    # round II: if still needs agriculture, take it from nature and from forest
    # round III: if still needs forest, take it from nature and from agriculture
    
    # this part of the code is not well written!
    LUs = {0 : "Forest",
           1 : "Natural",
           2 : "Agriculture"
           }
    alternateSourceLandUses = [[1,0], [1,2]]
    landuseNeeded = [2, 0]
    rounds = ["roundII", "roundIII"]
    
    for roundCount, round in enumerate(rounds):
        print round
        for alternateSource in alternateSourceLandUses[roundCount]:
            for rank in range(len(takers)):
                for tk in takersCollection:
                    #print "time for : " + LUs[landuseNeeded[roundCount]] + " for taker " + `tk.id`
                    # print tk.id, ":", tk.isSatisfied[landuseNeeded[roundCount]]
                    if not tk.isSatisfied[landuseNeeded[roundCount]]:
                        print "Looking for more " + LUs[landuseNeeded[roundCount]] + " in " + LUs[alternateSource]
                        for px in tk.sortedPx[alternateSource]:
                            if tk.takenCount[landuseNeeded[roundCount]] >= tk.need[landuseNeeded[roundCount]]:
                                tk.isSatisfied[landuseNeeded[roundCount]] = True
                                satisfied[landuseNeeded[roundCount]] += 1 # one of the takers is satisfied
                                print "found enough for " + LUs[landuseNeeded[roundCount]] + " for taker " + `tk.id`
                                break
                            else:
                                # check if taker is eligible to take this px
                                # print round + " taking from " + LUs[alternateSource] + " for " + LUs[landuseNeeded[roundCount]] 
                                if not px.isTaken and px.takerRank[tk.id] == rank:
                                    # take it
                                    tk.taken[round][alternateSource].append(px)
                                    tk.takenCount[landuseNeeded[roundCount]] += 1
                                    px.isTaken = True
                    else:
                        "taker " + `tk.id` + "is already satidfied for " + LUs[landuseNeeded[roundCount]]
    return takersCollection
    
i = DataTree[Object]()
i_I = DataTree[Object]()
i_II = DataTree[Object]()

needs = [forest, natural, agriculture, wetlands, water, developed]

takersCollection = main(pxPts, takers, needs)


for tk in takersCollection:
    for landUseId, landUsePxs in enumerate(tk.taken["roundI"]):
        p = GH_Path(tk.id, landUseId)
        pxIds = []
        for px in landUsePxs: pxIds.append(px.id)
        i.AddRange(pxIds, p)
    for landUseId, landUsePxs in enumerate(tk.taken["roundII"]):
        p = GH_Path(tk.id, landUseId)
        pxIds = []
        for px in landUsePxs: pxIds.append(px.id)
        i_I.AddRange(pxIds, p)
    for landUseId, landUsePxs in enumerate(tk.taken["roundIII"]):
        p = GH_Path(tk.id, landUseId)
        pxIds = []
        for px in landUsePxs: pxIds.append(px.id)
        i_II.AddRange(pxIds, p)
    
    
    
    # for each land use append the items index
    
#for takerID, itemList in itemsDict.items():
#    p = GH_Path(takerID, branchCount)
#    i.AddRange(itemList[0], p)
#    i_I.AddRange(itemList[1], p)
#    i_II.AddRange(itemList[2], p)
# ---------- end python ----------
entwine = Entwine(
    Branch00=panel_4,
    Branch01=panel_7,
    Branch02=panel_5,
    Branch03=panel_7,
    Branch04=panel_3,
    Branch05=panel_6,
    FlattenInputs=True)  # -> simplify(Result)
fixdatatree = PythonScript(pts_in=point_list, rect_in=rec, colors_in=col, needs_in=entwine, numOfPts=lng)  # -> pts, rect, colors, needs; inputs pts_in: tree of Point3d, rect_in: tree, colors_in: tree, needs_in: tree, numOfPts: Int32
# ---------- fixdatatree: Python ----------
import Rhino as rc
import scriptcontext as sc
import Grasshopper.Kernel as gh
from System import Object
from Grasshopper import DataTree
from Grasshopper.Kernel.Data import GH_Path

pts = DataTree[Object]()
rect = DataTree[Object]()
colors = DataTree[Object]()
needs = DataTree[Object]()

for number in range(numOfPts):
    for branchCount in range(pts_in.BranchCount):
        p = GH_Path(number, branchCount)
        pts.AddRange(pts_in.Branch(branchCount), p)
        rect.AddRange(rect_in.Branch(branchCount), p)
        colors.AddRange(colors_in.Branch(branchCount), p)        
        needs.AddRange(needs_in.Branch(branchCount), p)
# ---------- end fixdatatree ----------
num = Number([python.i, python.i_I, python.i_II])
lng_4 = ListLength(List=python.i)

# ---- group: taken third round
lng_5 = ListLength(List=python.i_II)

# ---- group: taken second round
lng_6 = ListLength(List=python.i_I)

# ---- group: taken first round
lng_7 = ListLength(List=python.i)

# ----
path_mapper = PathMapper(num, source="{A;B}", target="{B}")
pshift_3 = ShiftPaths(Data=lng_6, Offset=-1)
pshift_4 = ShiftPaths(Data=lng_5, Offset=-1)
pshift_5 = ShiftPaths(Data=lng_4, Offset=-1)
entwine_2 = Entwine(
    Branch00=panel_4,
    Branch01=panel_7,
    Branch02=panel_5,
    Branch03=panel_7,
    Branch04=panel_3,
    Branch05=panel_6,
    FlattenInputs=True)  # -> simplify(Result)
flip = FlipMatrix(Data=pshift_3)
flip_2 = FlipMatrix(Data=pshift_4)
num_2 = Number(path_mapper)
flip_3 = FlipMatrix(Data=pshift_5)
panel_8 = Panel(flip)
python_2 = PythonScript(x=num_2)  # -> a; inputs x: list of Int32
# ---------- python_2: Python ----------
a= set(x)
# ---------- end python_2 ----------
lng_8 = ListLength(List=num_2)
subtraction_2 = Subtraction(A=entwine_2, B=flip_3)
lng_9 = ListLength(List=python_2)

item_3 = ListItem(List=fixdatatree.pts, Index=python.i_II, Wrap=True)
item_4 = ListItem(List=fixdatatree.pts, Index=python.i_I, Wrap=True)
item_5 = ListItem(List=fixdatatree.pts, Index=python.i, Wrap=True)
merge = Merge(Data1=item_5, Data2=item_4, Data3=item_3)

# ---- group: Still needed after round I
panel_9 = Panel(subtraction_2)

# ---- group: selected @round II
item_6 = ListItem(List=fixdatatree.rect, Index=python.i_I, Wrap=True)

# ----
panel_10 = Panel(lng_9)

# ---- group: selected @round III
item_7 = ListItem(List=fixdatatree.rect, Index=python.i_II, Wrap=True)

# ----
panel_11 = Panel(lng_8)

# ---- group: selected @round I
item_8 = ListItem(List=fixdatatree.rect, Index=python.i, Wrap=True)

# ----
subtraction_3 = Subtraction(A=panel_9, B=panel_8)
merge_2 = Merge(Data1=item_8, Data2=item_6, Data3=item_7)
equals = Equality(FirstNumber=panel_11, SecondNumber=panel_10)  # -> Equality, Inequality
pshift_6 = ShiftPaths(Data=merge, Offset=-1)

# ---- group: Still needed after round II
panel_12 = Panel(subtraction_3)

# ----
panel_13 = Panel(equals.Equality)

# ---- group: Voronoi-Like shape!
hull = ConvexHull(Points=pshift_6, Plane=PlaneXY(0, 0, 0))  # -> Hull, HullZ, Indices

# ---- group: Shaded Cells
mesh = Mesh(merge_2)
mjoin = MeshJoin(Meshes=mesh)  # -> simplify(Mesh)
shaded_cells = CustomPreview(Geometry=mjoin, Shader=fixdatatree.colors)

# ---- group: Visualize for one of the points
point_selector = Slider(1, range=0..23)
series_2 = Series(Start=0, Step=1, Count=6)
panel_14 = Panel("{")  # disabled
int_8 = Integer(series_2)
int_9 = Integer(point_selector)
concat = Concatenate(FragmentC=panel_14, FragmentA=int_9, FragmentD=";", FragmentB=int_8, FragmentE="}")
branch = TreeBranch(Tree=mesh, Path=concat, MaintainPaths=True)

# ----
mjoin_2 = MeshJoin(Meshes=branch)  # -> simplify(Mesh)
subtraction_4 = Subtraction(A=panel_12, B=flip_2)
branch_2 = TreeBranch(Tree=hull.HullZ, Path=point_selector, MaintainPaths=True)

# ---- group: Still needed after round III
panel_15 = Panel(subtraction_4)

# ----
crv = Curve(flatten(hull.HullZ))
branch_3 = TreeBranch(Tree=crv, Path=Slider(0, range=0..2), MaintainPaths=True)
boundary = BoundarySurfaces(Edges=branch_3)
shaded_cells_2 = CustomPreview(Geometry=mjoin_2, Shader=fixdatatree.colors)
preview_2 = CustomPreview(Geometry=crv, Shader=grey_5)

# ---- group: Area Missing
item_9 = ListItem(List=subtraction_2, Index=point_selector, Wrap=True)
panel_16 = Panel(item_9)
panel_17 = Panel("""Forest
Natural
Agriculture
Wetlands
Water
Developed""")
multiplication = Multiplication(A=panel_16, B=cell_area_acres)
int_10 = Integer(point_selector)
round = Round(Number=multiplication)  # -> flatten(Nearest), Floor, Ceiling
concat_2 = Concatenate(FragmentA="Settlement Point ", FragmentB=int_10, FragmentC=" : ")
concat_3 = Concatenate(
    FragmentF=concat_2,
    FragmentA="Area missing for ",
    FragmentB=panel_17,
    FragmentC=" = ",
    FragmentD=round.Nearest,
    FragmentE=" Acres")
panel_18 = Panel(concat_3)
pt_2 = Point(Point(13.87565538, -1.672145601, 0))
join = TextJoin(Text=flatten(panel_18))
tag = TextTag3D(Location=pt_2, Text=flatten(join), Size=Slider(2, range=0..10), Colour=grey_5_2, Justification=7)
