# Grasshopper definition processImage.gh (Grasshopper 0.9.76)
# plug-ins: Python Interpreter

number_slider = Slider(100, range=0..100)
dom = ConstructDomain(DomainStart=0, DomainEnd=100)
range = Range(Domain=dom, Steps="100")
range_2 = Range(Domain=dom, Steps="100")
# image width = 598; image height = 794
panel = Panel("598")
pt = ConstructPoint(XCoordinate=graft(range_2), YCoordinate=range, ZCoordinate=0)  # -> simplify(flatten(Point))
division = Division(A="200", B="100")
addition = Addition(A="100", B=1)
partition = PartitionList(List=pt, Size=addition)
division_2 = Division(A="794", B=panel)
rev = ReverseList(List=partition)  # -> flatten(List)
image = ImageSampler(
    rev,
    FilePath="C:\Users\Administrator\Copy\development\SettlementEmerge\resources\LandCover_All_20140619_7Color.png",
    Filter="Colour",
    Interpolate=False,
    Umax=100,
    Umin=0,
    Vmax=100,
    Vmin=0,
    Wrap=1)
panel_2 = Panel("C:\Users\Administrator\Copy\development\SettlementEmerge\data")
panel_3 = Panel("\bitmapdata.json")
panel_4 = Panel("C:\Users\Administrator\Dropbox\Public\D3TestData")
concat = Concatenate(FragmentA=panel_4, FragmentB="\bitmapdata_LR.json")
panel_5 = Panel("\settlements.json")
location = Location(graft([Point(41.68403327, 12.24231564, 0), Point(81.30257099, 43.51843491, 0), Point(18.62301794, 39.54331683, 0), Point(45.84623676, 56.34129519, 0), Point(31.41763117, 46.64708472, 0), Point(30.72990428, 23.94732003, 0)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]))
concat_2 = Concatenate(FragmentA=panel_4, FragmentB="\settlements_LR.json")
panel_6 = Panel("""Panama
Cherry Creek
Ripley
Brocton
Westfield
Sherman
Sinclairville
Fredonia
Cassadaga
Chautauqua Institution
Frewsburg
Busti
Kennedy
Sunset Bay
Forestville
Dunkirk
Silver Creek
Falconer
Celoron
Bemus Point
Mayville
Lakewood
Jamestown West
Jamestown""")
name = Name(["Panama", "Cherry Creek", "Ripley", "Brocton", "Westfield", "Sherman", "Sincalirville", "Fredonia", "Cassadaga", "Chautauqua Institution", "Frewsburg", "Busti", "Kennedy", "Sunset Bay", "Forestville", "Dunkirk", "Silver Creek", "Falconer", "Celoron", "Bemus Point", "Mayville", "Lakewood", "Jamestown West", "Jamestown"])
panel_7 = Panel(name)
panel_8 = Panel("Sinclairville")

# ---- group: remove sides of the image
col = Colour(simplify(image))
lng = ListLength(List=col)
lng_2 = ListLength(List=range)
number_slider_2 = Slider(26, range=0..100)
series = Series(Start=0, Step=1, Count=lng)
panel_9 = Panel("172")
division_3 = Division(A=series, B=lng_2)
round = Round(Number=division_3)  # -> Nearest, Floor, Ceiling

# ----
cset = CreateSet(List=col)  # -> Set, Map
panel_10 = Panel(cset.Set)
division_4 = Division(A=number_slider_2, B=division)
division_5 = Division(A=panel_9, B=division)

# ---- group: remove sides of the image (continued)
larger = LargerThan(FirstNumber=round.Floor, SecondNumber=division_4)  # -> LargerThan, OrEqualTo
smaller = SmallerThan(FirstNumber=round.Floor, SecondNumber=division_5)  # -> SmallerThan, OrEqualTo
and = GateAnd(A=larger.LargerThan, B=smaller.SmallerThan)
dispatch = Dispatch(List=col, DispatchPattern=and)  # -> ListA, ListB
dispatch_2 = Dispatch(List=rev, DispatchPattern=and)  # -> ListA, ListB
lng_3 = ListLength(List=dispatch_2.ListA)
preview = CustomPreview(Geometry=dispatch_2.ListA, Shader=dispatch.ListA)
division_6 = Division(A=lng_3, B=lng_2)

# ----
txt = Text(dispatch.ListA)
writecelljson = PythonScript(points=dispatch_2.ListA, colors=txt, numOfCol=lng_2, filepath=concat)  # -> out, selPts, row, col, pxData; inputs points: list of Point3d, colors: list, numOfCol: Int32
# ---------- writecelljson: Python ----------
import json
"""
colors_d = {"0,0,0" : "#000000",
"19,116,132" : "#137484",
"0,163,219" : "#00A3DB",
"155,217,86" : "#9BD956",
"230,56,92": "#E6385C",
"245,234,11" : "#F5EA0B",
"62,202,102" : "#3ECA66"}
"""

colors_d = {"0,0,0" : "none",
"19,116,132" : "Wetlands",
"0,163,219" : "Water",
"155,217,86" : "Natural",
"230,56,92": "Developed",
"245,234,11" : "Agriculture",
"62,202,102" : "Forest"}

row = []
col = []
selPts = []
data = {"numOfCol" : str(numOfCol),
        "cellArea" : "0.04",
        "cells" : []
        }
        
for i, pt in enumerate(points):
    landuse = colors_d[str(colors[i])]
    if landuse == "none": continue
    x = int(i/numOfCol)
    y = i%numOfCol
    row.append(y)
    col.append(x)
    selPts.append(pt)
    cell = { "id":i, "x":x, "y":y, "landuse":landuse}
    data["cells"].append(cell)


with open(filepath, "w") as outf:
    outf.write(json.dumps(data))


class dict2Class():
    def __init__(self, dictionary):
        self.dict = dictionary

pxData = dict2Class(data)
# ---------- end writecelljson ----------
cp = ClosestPoint(Point=location, Cloud=writecelljson.selPts)  # -> ClosestPoint, flatten(CPIndex), Distance
item = ListItem(List=writecelljson.col, Index=cp.CPIndex, Wrap=True)  # -> flatten(Item)
item_2 = ListItem(List=writecelljson.row, Index=cp.CPIndex, Wrap=False)  # -> flatten(Item)
create_city_objects = PythonScript(
    name=panel_6,
    population=["4572", "5211", "2452", "5579", "4896", "4813", "4674", "11702", "4527", "3618", "5999", "4122", "4558", "637", "4790", "12836", "2035", "2619", "1686", "4457", "917", "3229", "1834", "31146"],
    filepath=concat_2,
    x=item,
    y=item_2)  # -> out, citiesData; inputs name: list, population: list, x: list, y: list
# ---------- create_city_objects: Python ----------
import json

settlements = [];
# "name":"some city name", "x":"25", "y": "200", "population":"200000"}

for i, city in enumerate(name):
    c = {
        "name": city,
        "x": x[i],
        "y": y[i],
        "population": population[i]
         }
    settlements.append(c)


with open(filepath, "w") as outf:
    outf.write(json.dumps(settlements))


class dictToClass():
    def __init__(self, dictionary):
        self.dict = dictionary

citiesData = dictToClass(settlements)
# ---------- end create_city_objects ----------
modify_and_right_cities_to_json = PythonScript(celldata=writecelljson.pxData, citiesData=create_city_objects.citiesData, filepath=concat_2)  # -> out, a
# ---------- modify_and_right_cities_to_json: Python ----------
import json
import math

class sourcePx(object):
    def __init__(self, cell):
        self.id = cell["id"]
        self.x = cell["x"]
        self.y = cell["y"]
        self.landuse = cell["landuse"]
        self.isTaken = False
        
    def rankCities(self, cities):
        
        # calculate distance
        for city in cities: self.getDistanceTo(city)
        
        # sort points based on distance
        sortedCities = sorted(cities,  key=lambda city: city.distanceTo[self.id])
        
        # put pixel in the right position in city object
        for count, city in enumerate(sortedCities):
            # create a list for each rank
            if not city.rankedResources[self.landuse].has_key(count):
                city.rankedResources[self.landuse][count] = []
                
            city.rankedResources[self.landuse][count].append(self)
        
    def getDistanceTo(self, city):
        city.distanceTo[self.id] = round(math.sqrt((city.x - self.x)**2 + (city.y - self.y)**2),2)
        
        
class settlement(object):
    
    def __init__(self, city):
        self.id = city["name"]
        self.x = city["x"]
        self.y = city["y"]
        self.population = city["population"]
        self.distanceTo = {}
        self.rankedResources = {"Wetlands":{},
                                "Water":{},
                                "Natural":{},
                                "Developed":{},
                                "Forest":{},
                                "Agriculture":{}}
        self.sortedResourcesIds = {"Wetlands":{},
                        "Water":{},
                        "Natural":{},
                        "Developed":{},
                        "Forest":{},
                        "Agriculture":{}}
        
    def sortPxBasedOnDist(self):
        # sort points based on distance
        for landuse in self.rankedResources.keys():
            for rank, pxlist in self.rankedResources[landuse].items():
                self.rankedResources[landuse][rank] = \
                    sorted(pxlist,  key=lambda px: self.distanceTo[px.id])
            
                self.sortedResourcesIds[landuse][rank] = []
                # replace them with ids so I can write them to json.
                # I will replace them back with objects
                for px in self.rankedResources[landuse][rank]:
                    self.sortedResourcesIds[landuse][rank].append(px.id)



citiesData = citiesData.dict
cities = []
for city in citiesData:
    cities.append(settlement(city))

# read cell data
data = celldata.dict
cells = data["cells"] #list of cells

# create a pixel object out of each cell
for cell in cells:
    px = sourcePx(cell)
    
    # rank cities for this point based on distance
    px.rankCities(cities)

# sort pixles inside lists and replace them with ids
modifiedCities = []
modifiedCityDict = {}
for city in cities:
    city.sortPxBasedOnDist()
    modifiedCityDict = {
        "x" : city.x,
        "y" : city.y,
        "name" : city.id,
        "population": city.population,
        "sortedResourcesIds" : city.sortedResourcesIds
        #"distanceTo" : city.distanceTo
    }
    modifiedCities.append(modifiedCityDict)

with open(filepath, "w") as outf:
    outf.write(json.dumps(modifiedCities))
# ---------- end modify_and_right_cities_to_json ----------
